# Grasshopper definition gh2vvvv.gh (Grasshopper 0.9.14)
# plug-ins: HoopSnake, gHowl

panel = Panel("""192.168.1.101 : VVVV
192.168.1.102 : Grasshopper
192.168.1.103 : Max/MSP""")

# ----
# localhost / IP
localhost_ip = BooleanToggle(False)

max_msp_ip = Panel("192.168.1.2")
gh_ip = Panel("192.168.1.4")

# ----
# from MAX Attractors
gh_ip_2 = Panel(gh_ip)
filter = StreamFilter(Gate=localhost_ip, Stream1=gh_ip_2)
udp = UDPReceiver(Address=filter, Port="4445", Pattern=999)  # -> Info, Data
shift = ShiftList(List=udp.Data, Shift=1, Wrap=False)

vvvv_ip = Panel("192.168.1.4")

expression = Expression(x="1920", Expression="x*3")

rectangle = Rectangle(Plane=PlaneXY(0, 0, 0), XSize=expression, YSize="1080", Radius=0)  # -> Rectangle, Length
panel_2 = Panel("""0.1
0.5
0.4
0.6
0.8
0.1""")
pop2d = Populate2D(Region=rectangle.Rectangle, Count="100", Seed=1)
sort_pt = SortPoints(Points=pop2d)  # -> Points, Indices
expression_2 = Expression(x=expression, y="3000", Expression="(x+y)/2")
expression_3 = Expression(x="1080", y="3000", Expression="(x+y)/2")
filter_2 = StreamFilter(Gate=Toggle(False), Stream0=shift, Stream1=panel_2)
pt = Point(flatten(sort_pt.Points))
bbox = BoundingBox(Content=pt, Plane=PlaneXY(0, 0, 0), UnionBox=True)  # -> Box, Box_2
dispatch = Dispatch(List=filter_2, DispatchPattern=[True, False])  # -> ListA, ListB
dom = Domain(DomainStart=0, DomainEnd=expression)
dom_2 = Domain(DomainStart=0, DomainEnd="1080")
area = Area(Geometry=bbox.Box)  # -> Area, Centroid
box = CenterBox(Base=area.Centroid, X=expression_2, Y=expression_3, Z=1)
remap = RemapNumbers(Value=dispatch.ListB, Source="0.0 To 1.0", Target=dom_2)
remap_2 = RemapNumbers(Value=dispatch.ListA, Source="0.0 To 1.0", Target=dom)
valuemultiplicator = Slider(20, range=-1..200)
decay = Slider(0.44, range=0..3)
pt_2 = PointXYZ(XComponent=remap_2, YComponent=remap, ZComponent=0, System=PlaneXY(0, 0, 0))
multiplication = Multiplication(A=[Slider(100, range=-100..100), Slider(-56, range=-100..100), Slider(100, range=-100..100)], B=valuemultiplicator)
pcharge = PointCharge(Point=pt_2, Charge=multiplication, Decay=decay)
mergef = MergeFields(Fields=pcharge)
fscalar = ScalarDisplay(Field=mergef, Section=rectangle.Rectangle, Samples=2000)  # disabled
evf = EvaluateField(Field=mergef, Point=pt)  # -> Tensor, Strength
move = Move(Geometry=pt, Motion=evf.Tensor)  # -> Geometry, Transform
vdisex = VectorDisplayEx(Point=pt, Vector=evf.Tensor, Colour=RGB(0, 0, 0), Width=3)  # disabled
pt_3 = Point(flatten(move.Geometry))

# ----
# Center Points
dirección_osc = Panel("/GH/CenterPointsXY")
pcomp = Decompose(Point=pt_3, System=PlaneXY(0, 0, 0))  # -> XComponent, YComponent, ZComponent
int = Integer(pcomp.XComponent)
int_2 = Integer(pcomp.YComponent)
merge = Merge(Data1=graft(int), Data2=graft(int_2))
join = StringJoin(Strings=merge, Join=" ")
vvvv_ip_2 = Panel(vvvv_ip)
merge_2 = Merge(Data1=dirección_osc, Data2=join)  # -> flatten(Result)
filter_3 = StreamFilter(Gate=localhost_ip, Stream1=vvvv_ip_2)
udp_2 = UDPSender(Address=filter_3, Port="6666", Pattern=999, Data=merge_2)
panel_3 = Panel(udp_2)

box_2 = Box(box)
voronoi = Voronoi(Points=pt_3, Radius=3000, Box=box_2, Plane=PlaneXY(0, 0, 0), BruteForceOverride=False)
max_msp_ip_2 = Panel(max_msp_ip)
filter_4 = StreamFilter(Gate=localhost_ip, Stream1=max_msp_ip_2)

# ----
# Center Points / 64p
reduce = RandomReduce(List=flatten(join), Reduction=36, Seed=1)
join_2 = StringJoin(Strings=reduce, Join=" ")
merge_3 = Merge(Data1=dirección_osc, Data2=join_2)  # -> flatten(Result)
udp_3 = UDPSender(Address=filter_4, Port="6667", Pattern=999, Data=merge_3)
panel_4 = Panel(udp_3)

# ----
# Отсюда можно отключить
# для скорости
cp = ControlPoints(Curve=voronoi)  # -> Points, Weights, Knots
shift_2 = ShiftList(List=cp.Points, Shift=-1, Wrap=False)
pt_4 = Point(graft(pt_3))

toggle = BooleanToggle(False)

# ----
# Deep Polygon
panel_5 = Panel("6669")
gh_ip_3 = Panel(gh_ip)
filter_5 = StreamFilter(Gate=localhost_ip, Stream1=gh_ip_3)
udp_4 = UDPReceiver(Address=filter_5, Port=panel_5, Pattern=0)  # -> Info, Data
split = StringSplit(String=udp_4.Data, Separators=" ")

dist = Distance(PointA=shift_2, PointB=pt_4)
avr = Average(Input=dist)
max_msp_ip_3 = Panel(max_msp_ip)
filter_6 = StreamFilter(Gate=localhost_ip, Stream1=max_msp_ip_3)

range = Range(Domain=Domain(0, 1), Steps=99)  # disabled
panel_6 = Panel("100")  # disabled
graph = GraphMapper(
    range,
    x0=0,
    x1=1,
    y0=0,
    y1=1,
    container_name="Parabola",
    Ox=0.5014507174,
    Oy=0.06376758218,
    Px=0.7797108293,
    Py=0.3420286179)  # disabled
multiplication_2 = Multiplication(A=udp_4.Data, B=panel_6)  # disabled
shift_3 = ShiftList(List=graph, Shift=multiplication_2, Wrap=True)  # disabled

series = Series(Start=0, Step=1, Count="9")
number_slider = Slider(0.43, range=0..1)
num = Number(graft(split))

Z = UnitZ(Factor=1)
X = UnitX(Factor=1)

# ----
# Polygon Deep / 32
dirección_osc_2 = Panel("/GH/PolygonDeep")
reduce_2 = RandomReduce(List=flatten(split), Reduction=68, Seed=1)

join_3 = StringJoin(Strings=reduce_2, Join=" ")

merge_4 = Merge(Data1=dirección_osc_2, Data2=join_3)  # -> flatten(Result)
udp_5 = UDPSender(Address=filter_6, Port="6671", Pattern=999, Data=merge_4)
panel_7 = Panel(udp_5)

range_2 = Range(Domain=Domain(0.3, 0.6), Steps=8)  # disabled

# ----
# Polygon Points
dirección_osc_3 = Panel("/GH/VoronoiPointsXY")
vvvv_ip_3 = Panel(vvvv_ip)
filter_7 = StreamFilter(Gate=localhost_ip, Stream1=vvvv_ip_3)

slider = Slider(603, range=600..620)  # disabled

item = ListItem(List=hs.FeedbackHistory, Index=0, Wrap=False)
pt_5 = Point(item)  # disabled
rec = DataRecorder(pt_5, RecordData=True, DataLimit=1)  # disabled
dam = DataDam(DataA=rec, BufferDelay=2500000, BufferMode=1)  # disabled
vec2pt = Vector2Pt(PointA=pt_4, PointB=item, Unitize=False)  # -> Vector, Length
vrot = Rotate(Vector=vec2pt.Vector, Axis=Z, Angle=Slider(0.37, range=0..1))
angle = Angle(VectorA=X, VectorB=vrot)  # -> Angle, Reflex
prot = RotatePlane(Plane=pt_4, Angle=angle.Angle)
vdisex_2 = VectorDisplayEx(Point=prot, Vector=vrot, Colour=RGB(0, 0, 0), Width=1)  # disabled

cir = Circle(Plane=prot, Radius=avr)
crv_cp = CurveCP(Point=shift_2, Curve=cir)  # -> Point, Parameter, Distance
sort = SortList(Keys=crv_cp.Parameter, ValuesA=shift_2)  # -> Keys, ValuesA
hs = HoopSnake(
    StartingData=shift_2,
    Data=sort.ValuesA,
    TerminationCondition=toggle,
    Trigger=toggle,
    Hoopsnake_Data_dataLimit=2147483647,
    Hoopsnake_Data_resetCounter=True,
    Hoopsnake_Data_updateView=True,
    Hoopsnake_Data_autoUpdate=False)  # -> Feedback, FeedbackHistory, LoopsCounter, IterationsCounter
shift_4 = ShiftList(List=sort.ValuesA, Shift=0, Wrap=True)
split_2 = SplitList(List=shift_4, Index="9")  # -> ListA, ListB
long = LongList(ListA=split_2.ListA, ListB=series, PaddingMode=2)  # -> ListA, ListB
pt_6 = Point(long.ListA)
ln = Line(StartPoint=pt_6, EndPoint=pt_4)
eval = EvaluateCurve(Curve=ln, Parameter=num)  # -> Point, Tangent, Angle
shift_5 = ShiftList(List=pt_6, Shift=0, Wrap=True)  # -> graft(List)
shift_6 = ShiftList(List=pt_6, Shift=-1, Wrap=True)  # -> graft(List)
shift_7 = ShiftList(List=eval.Point, Shift=0, Wrap=True)  # -> graft(List)
shift_8 = ShiftList(List=eval.Point, Shift=-1, Wrap=True)  # -> graft(List)
merge_5 = Merge(Data1=shift_5, Data2=shift_6, Data3=shift_7, Data4=shift_8)
pt_7 = Point(flatten(merge_5))
pcomp_2 = Decompose(Point=pt_7, System=PlaneXY(0, 0, 0))  # -> XComponent, YComponent, ZComponent

merge_6 = Merge(Data1=shift_5, Data2=shift_6, Data3=shift_8, Data4=shift_7)  # disabled
pline = PolyLine(Vertices=merge_6, Closed=True)  # disabled
planar = PlanarSrf(Edges=flatten(pline))  # disabled

eval_2 = EvaluateCurve(Curve=ln, Parameter=range_2)  # -> Point, Tangent, Angle; disabled
path_mapper = PathMapper(pline, source="{A;B;C;D;E;F;G;H}", target="{C}")  # disabled
pcen = PolygonCenter(Polyline=path_mapper)  # -> CenterV, CenterE; disabled
points = PointList(Points=pcen.CenterE, Tags=True, Lines=True, Size=10)  # disabled

int_3 = Integer(pcomp_2.XComponent)
int_4 = Integer(pcomp_2.YComponent)

merge_7 = Merge(Data1=graft(int_3), Data2=graft(int_4))
join_4 = StringJoin(Strings=merge_7, Join=" ")  # -> flatten(Result)
merge_8 = Merge(Data1=dirección_osc_3, Data2=join_4)  # -> flatten(Result)
udp_6 = UDPSender(Address=filter_7, Port="7777", Pattern=999, Data=merge_8)
panel_8 = Panel(udp_6)

# ---- group: save to ram file
merge_9 = Merge(Data1=graft(int_3), Data2=graft(int_4))  # -> flatten(Result); disabled
join_5 = StringJoin(Strings=merge_9, Join=" ")  # disabled
rec_2 = DataRecorder(join_5, RecordData=True, DataLimit=2)  # disabled
clean = CleanTree(Data=rec_2, CleanInvalid=True, CleanEmpty=False)  # disabled
item_2 = ListItem(List=clean, Index=0, Wrap=False)  # disabled

# ----
item_3 = ListItem(List=flatten(pline), Index=slider, Wrap=False)  # disabled
planar_2 = PlanarSrf(Edges=flatten(item_3))  # disabled

panel_9 = Panel(item_2)  # disabled
